# Grasshopper definition KinergyMainInterface.gh (Grasshopper 1.0.7)
# plug-ins: Human UI

# ---- group: Interface Logic
c_script = CSharpScript()  # -> out, A
# ---------- c_script: C# ----------
    GH_Document gh_d = owner.OnPingDocument();

    if (gh_d.IsFilePathDefined)
    {
      Print("A path is defined.");
      A = gh_d.FilePath;
    }
    else
    {
      Print("No path defined.");
    }
# ---------- end c_script ----------
python = GhPythonScript(x=c_script.A)  # -> a
# ---------- python: Python ----------
__author__ = "ediga"
__version__ = "2020.08.24"

import rhinoscriptsyntax as rs

idx = x.index("KinergyMainInterface.gh")

a = x[0:idx] + "Resources\images\conrot.png"
# ---------- end python ----------
width = Slider(75, range=0..1000)
height = Slider(75, range=0..1000)
panel = Panel(python)
button = CreateButton(ImagePath=panel, ButtonStyle=0)
adjustpos = AdjustElementPositioning(
    ElementsToAdjust=button,
    Margin="5,-10,0,5",
    AbsolutePositioning=False,
    Width=width,
    Height=height,
    HorizontalAlignment=Slider(0, range=0..100))
c_script_2 = CSharpScript()  # -> out, A; same code as c_script
python_2 = GhPythonScript(x=c_script_2.A)  # -> a
# ---------- python_2: Python ----------
__author__ = "ediga"
__version__ = "2020.08.24"

import rhinoscriptsyntax as rs

idx = x.index("KinergyMainInterface.gh")

a = x[0:idx] + "Resources\images\\reciprocate.png"
# ---------- end python_2 ----------
c_script_3 = CSharpScript()  # -> out, A; same code as c_script
height_2 = Slider(35, range=0..1000)
width_2 = Slider(186, range=0..1000)
height_3 = Slider(75, range=0..1000)
width_3 = Slider(75, range=0..1000)
height_4 = Slider(40, range=0..1000)
python_3 = GhPythonScript(x=c_script_3.A)  # -> a
# ---------- python_3: Python ----------
__author__ = "ediga"
__version__ = "2020.08.24"

import rhinoscriptsyntax as rs

idx = x.index("KinergyMainInterface.gh")

a = x[0:idx] + "Resources\images\instrans.png"
# ---------- end python_3 ----------
width_4 = Slider(186, range=0..1000)
width_5 = Slider(75, range=0..1000)
height_5 = Slider(75, range=0..1000)
panel_2 = Panel(python_2)
panel_3 = Panel(python_3)
label = CreateLabel(LabelText="Periodic Motion", LabelSize=12, Justification=0)
adjustpos_2 = AdjustElementPositioning(
    ElementsToAdjust=label,
    Margin="0,0,0,5",
    AbsolutePositioning=False,
    Width=width_2,
    Height=height_2,
    HorizontalAlignment=Slider(0, range=0..100))
label_2 = CreateLabel(LabelText="Non-periodic Motion", LabelSize=12, Justification=0)
adjustpos_3 = AdjustElementPositioning(
    ElementsToAdjust=label_2,
    Margin="0,0,0,5",
    AbsolutePositioning=False,
    Width=width_4,
    Height=height_4,
    HorizontalAlignment=Slider(0, range=0..100))
button_2 = CreateButton(ImagePath=panel_2, ButtonStyle=0)
adjustpos_4 = AdjustElementPositioning(
    ElementsToAdjust=button_2,
    Margin="85,-80,0,5",
    AbsolutePositioning=False,
    Width=width_3,
    Height=height_3,
    HorizontalAlignment=Slider(0, range=0..100))
button_3 = CreateButton(ImagePath=panel_3, ButtonStyle=0)
adjustpos_5 = AdjustElementPositioning(
    ElementsToAdjust=button_3,
    Margin="5,-15,0,5",
    AbsolutePositioning=False,
    Width=width_5,
    Height=height_5,
    HorizontalAlignment=Slider(0, range=0..100))
c_script_4 = CSharpScript()  # -> out, A; same code as c_script
c_script_5 = CSharpScript()  # -> out, A; same code as c_script
python_4 = GhPythonScript(x=c_script_4.A)  # -> a
# ---------- python_4: Python ----------
__author__ = "ediga"
__version__ = "2020.08.24"

import rhinoscriptsyntax as rs

idx = x.index("KinergyMainInterface.gh")

a = x[0:idx] + "Resources\images\intosci.png"
# ---------- end python_4 ----------
python_5 = GhPythonScript(x=c_script_5.A)  # -> a
# ---------- python_5: Python ----------
__author__ = "ediga"
__version__ = "2020.08.24"

import rhinoscriptsyntax as rs

idx = x.index("KinergyMainInterface.gh")

a = x[0:idx] + "Resources\images\insrot.png"
# ---------- end python_5 ----------
width_6 = Slider(75, range=0..1000)
height_6 = Slider(75, range=0..1000)
width_7 = Slider(75, range=0..1000)
height_7 = Slider(75, range=0..1000)
panel_4 = Panel(python_4)
panel_5 = Panel(python_5)
button_4 = CreateButton(ImagePath=panel_4, ButtonStyle=0)
adjustpos_6 = AdjustElementPositioning(
    ElementsToAdjust=button_4,
    Margin="165,-80,0,5",
    AbsolutePositioning=False,
    Width=width_6,
    Height=height_6,
    HorizontalAlignment=Slider(0, range=0..100))
button_5 = CreateButton(ImagePath=panel_5, ButtonStyle=0)
adjustpos_7 = AdjustElementPositioning(
    ElementsToAdjust=button_5,
    Margin="85,-80,0,5",
    AbsolutePositioning=False,
    Width=width_7,
    Height=height_7,
    HorizontalAlignment=Slider(0, range=0..100))
c_script_6 = CSharpScript()  # -> out, A; same code as c_script
python_6 = GhPythonScript(x=c_script_6.A)  # -> a
# ---------- python_6: Python ----------
__author__ = "ediga"
__version__ = "2020.08.24"

import rhinoscriptsyntax as rs

idx = x.index("KinergyMainInterface.gh")

a = x[0:idx] + "Resources\images\introt.png"
# ---------- end python_6 ----------
c_script_7 = CSharpScript()  # -> out, A; same code as c_script
width_8 = Slider(75, range=0..1000)
height_8 = Slider(75, range=0..1000)
width_9 = Slider(329, range=0..1000)
height_9 = Slider(30, range=0..1000)
python_7 = GhPythonScript(x=c_script_7.A)  # -> a
# ---------- python_7: Python ----------
__author__ = "ediga"
__version__ = "2020.08.24"

import rhinoscriptsyntax as rs

idx = x.index("KinergyMainInterface.gh")

a = x[0:idx] + "Resources\images\contrans.png"
# ---------- end python_7 ----------
panel_6 = Panel(python_6)
width_10 = Slider(75, range=0..1000)
height_10 = Slider(75, range=0..1000)
panel_7 = Panel(python_7)
titlesize = Slider(15, range=0..30)
button_6 = CreateButton(ImagePath=panel_6, ButtonStyle=0)
adjustpos_8 = AdjustElementPositioning(
    ElementsToAdjust=button_6,
    Margin="245,-80,0,5",
    AbsolutePositioning=False,
    Width=width_8,
    Height=height_8,
    HorizontalAlignment=Slider(0, range=0..100))
button_7 = CreateButton(ImagePath=panel_7, ButtonStyle=0)
adjustpos_9 = AdjustElementPositioning(
    ElementsToAdjust=button_7,
    Margin="165,-80,0,10",
    AbsolutePositioning=False,
    Width=width_10,
    Height=height_10,
    HorizontalAlignment=Slider(0, range=0..100))
label_3 = CreateLabel(LabelText="Select a target motion type:", LabelSize=12, Justification=0)
adjustpos_10 = AdjustElementPositioning(
    ElementsToAdjust=label_3,
    Margin="0,0,0,0",
    AbsolutePositioning=False,
    Width=width_9,
    Height=height_9,
    HorizontalAlignment=Slider(0, range=0..100))
adjustelem = AdjustElementAppearance(ElementsToAdjust=label_3, FontSize=titlesize)

# ----
height_11 = Slider(34, range=0..1000)
width_11 = Slider(100, range=0..1000)
panel_8 = Panel("""Short
Long
Longer""")
height_12 = Slider(30, range=0..30)
width_12 = Slider(50, range=0..400)
height_13 = Slider(30, range=0..30)
width_13 = Slider(50, range=0..400)
height_14 = Slider(34, range=0..1000)
width_14 = Slider(110, range=0..1000)
pulldown = CreatePulldownMenu(Label="Dis", ListItems=panel_8, showLabel=True)
adjustpos_11 = AdjustElementPositioning(
    ElementsToAdjust=pulldown,
    Margin="227,-45,0,10",
    AbsolutePositioning=False,
    Width=width_11,
    Height=height_11,
    HorizontalAlignment=Slider(0, range=0..100))
label_4 = CreateLabel(LabelText="(0°-90°)", LabelSize=12, Justification=0)
label_5 = CreateLabel(LabelText="Fatest", LabelSize=12, Justification=0)
panel_9 = Panel("""small
medium
big""")
adjustpos_12 = AdjustElementPositioning(
    ElementsToAdjust=label_4,
    Margin="5,-13,0,0",
    AbsolutePositioning=False,
    Width=width_12,
    Height=height_12,
    HorizontalAlignment=Slider(0, range=0..100))
adjustelem_2 = AdjustElementAppearance(ElementsToAdjust=label_4, Background="255,255,255")
adjustpos_13 = AdjustElementPositioning(
    ElementsToAdjust=label_5,
    Margin="290,-75,0,5",
    AbsolutePositioning=False,
    Width=width_13,
    Height=height_13,
    HorizontalAlignment=Slider(0, range=0..100))
adjustelem_3 = AdjustElementAppearance(ElementsToAdjust=label_5, Background="255,255,255")
pulldown_2 = CreatePulldownMenu(Label="Amp", ListItems=panel_9, showLabel=True)
adjustpos_14 = AdjustElementPositioning(
    ElementsToAdjust=pulldown_2,
    Margin="218,-45,0,10",
    AbsolutePositioning=False,
    Width=width_14,
    Height=height_14,
    HorizontalAlignment=Slider(0, range=0..100))
speed = Slider(4, range=0..9)
slider = CreateSlider(Slider=speed, ShowBounds=False, ShowTicks=False, ShowTooltip=False, ShowValLabel=True, showLabel=True)

# ---- group: Interface Button Logic
values = ValueListener(Elements=button_4, SomeProperty=True)  # -> Values, Indices
values_2 = ValueListener(Elements=button_6, SomeProperty=True)  # -> Values, Indices
values_3 = ValueListener(Elements=button_7, SomeProperty=True)  # -> Values, Indices
values_4 = ValueListener(Elements=button_3, SomeProperty=True)  # -> Values, Indices
values_5 = ValueListener(Elements=button_5, SomeProperty=True)  # -> Values, Indices
values_6 = ValueListener(Elements=button_2, SomeProperty=True)  # -> Values, Indices
values_7 = ValueListener(Elements=button, SomeProperty=True)  # -> Values, Indices
motionselection = BtnSelectionComponent(
    InsTransBtnClicked=values_4.Values,
    InsRotationBtnClicked=values_5.Values,
    ConTransBtnClicked=values_3.Values,
    ConRotBtnClicked=values_7.Values,
    RecipBtnClicked=values_6.Values,
    InterOscillationBtnClicked=values.Values,
    InterRotBtnClicked=values_2.Values)  # -> InsTransPanel, InsRotationPanel, ConTransPanel, ConRotPanel, RecipPanel, InterOscillationPanel, InterRotPanel, DefaultPanel

# ---- group: Instant Translation Kinetic Unit
height_15 = Slider(30, range=0..30)
width_15 = Slider(186, range=0..400)
label_6 = CreateLabel(LabelText="Motion characteristics:", LabelSize=12, Justification=0)
adjustelem_4 = AdjustElementAppearance(ElementsToAdjust=label_6, Background="255,255,255")
adjustpos_15 = AdjustElementPositioning(
    ElementsToAdjust=label_6,
    Margin="5,5,0,0",
    AbsolutePositioning=False,
    Width=width_15,
    Height=height_15,
    HorizontalAlignment=Slider(0, range=0..100))
width_16 = Slider(566, range=0..1000)
height_16 = Slider(38, range=0..1000)
width_17 = Slider(300, range=0..1000)
width_18 = Slider(300, range=0..1000)
height_17 = Slider(35, range=0..1000)
height_18 = Slider(35, range=0..1000)
height_19 = Slider(30, range=0..30)
width_19 = Slider(50, range=0..400)
width_20 = Slider(300, range=0..1000)
height_20 = Slider(35, range=0..1000)
label_7 = CreateLabel(LabelText="Max", LabelSize=12, Justification=0)
label_8 = CreateLabel(LabelText="Instant Translation Kinetic Unit", LabelSize=12, Justification=0)
adjustpos_16 = AdjustElementPositioning(
    ElementsToAdjust=label_7,
    Margin="280,-50,0,5",
    AbsolutePositioning=False,
    Width=width_19,
    Height=height_19,
    HorizontalAlignment=Slider(0, range=0..100))
button_8 = CreateButton(ButtonName="Step 3: select the end-effector", ButtonStyle=0)
adjustelem_5 = AdjustElementAppearance(ElementsToAdjust=label_7, Background="255,255,255")
button_9 = CreateButton(ButtonName="Step 1: select the target body  for embedding the unit", ButtonStyle=0)
button_10 = CreateButton(ButtonName="Step 2: select the translation axis", ButtonStyle=0)
adjustpos_17 = AdjustElementPositioning(
    ElementsToAdjust=button_9,
    Margin="10,-10,0,10",
    AbsolutePositioning=False,
    Width=width_20,
    Height=height_20,
    HorizontalAlignment=Slider(0, range=0..100))
adjustpos_18 = AdjustElementPositioning(
    ElementsToAdjust=label_8,
    Margin="0,5,0,10",
    AbsolutePositioning=False,
    Width=width_16,
    Height=height_16,
    HorizontalAlignment=Slider(0, range=0..100))
adjustpos_19 = AdjustElementPositioning(
    ElementsToAdjust=button_8,
    Margin="10,5,0,10",
    AbsolutePositioning=False,
    Width=width_17,
    Height=height_17,
    HorizontalAlignment=Slider(0, range=0..100))
strength_min = Slider(4, range=0..9)
adjustpos_20 = AdjustElementPositioning(
    ElementsToAdjust=button_10,
    Margin="10,5,0,10",
    AbsolutePositioning=False,
    Width=width_18,
    Height=height_18,
    HorizontalAlignment=Slider(0, range=0..100))
displacement_min = Slider(4, range=0..9)
height_21 = Slider(30, range=0..30)
width_21 = Slider(50, range=0..400)
width_22 = Slider(295, range=0..400)
colour = ColourPicker(PickedColour=RGB(51, 121, 200))
height_22 = Slider(30, range=0..30)
width_23 = Slider(295, range=0..400)
height_23 = Slider(30, range=0..30)
label_9 = CreateLabel(LabelText="Max", LabelSize=12, Justification=0)
slider_2 = CreateSlider(Slider=strength_min, ShowBounds=False, ShowTicks=False, ShowTooltip=False, ShowValLabel=True, showLabel=True)
adjustpos_21 = AdjustElementPositioning(
    ElementsToAdjust=label_9,
    Margin="280,-55,0,5",
    AbsolutePositioning=False,
    Width=width_21,
    Height=height_21,
    HorizontalAlignment=Slider(0, range=0..100))
adjustelem_6 = AdjustElementAppearance(ElementsToAdjust=label_9, Background="255,255,255")
slider_3 = CreateSlider(Slider=displacement_min, ShowBounds=False, ShowTicks=False, ShowTooltip=False, ShowValLabel=True, showLabel=True)
titlesize_2 = Slider(15, range=0..30)
adjustpos_22 = AdjustElementPositioning(
    ElementsToAdjust=slider_3,
    Margin="5,5,0,10",
    AbsolutePositioning=False,
    Width=width_22,
    Height=height_22,
    HorizontalAlignment=Slider(0, range=0..100))
adjustpos_23 = AdjustElementPositioning(
    ElementsToAdjust=slider_2,
    Margin="5,0,0,5",
    AbsolutePositioning=False,
    Width=width_23,
    Height=height_23,
    HorizontalAlignment=Slider(0, range=0..100))
adjustelem_7 = AdjustElementAppearance(ElementsToAdjust=label_8, Foreground=colour, FontSize=titlesize_2)
colour_2 = ColourPicker(PickedColour=RGB(230, 230, 230))
separatorheight = Slider(10, range=0..10)
width_24 = Slider(400, range=0..1000)
true_button = CreateTrueOnlyButton(ButtonName="Preview", ButtonStyle=0)
width_25 = Slider(80, range=0..1000)
height_24 = Slider(30, range=0..1000)
width_26 = Slider(450, range=0..1000)
checkbox = CreateCheckbox(Label="Add a lock", StartingValue=False)
height_25 = Slider(35, range=0..1000)
width_27 = Slider(80, range=0..1000)
height_26 = Slider(30, range=0..1000)
button_11 = CreateButton(ButtonName="Finish", ButtonStyle=0)
separator = CreateSeparator(Thickness=0.5, Horizontal=True, Color=colour_2, Width=width_24, Height=separatorheight)
merge = Merge(
    Data2=label_8,
    Data3=button_9,
    Data4=button_10,
    Data5=button_8,
    Data6=label_6,
    Data7=slider_3,
    Data8=label_9,
    Data9=slider_2,
    Data10=label_7,
    Data11=separator,
    Data12=checkbox,
    Data13=true_button,
    Data14=button_11)
adjustpos_24 = AdjustElementPositioning(
    ElementsToAdjust=true_button,
    Margin="140,-45,0,10",
    AbsolutePositioning=False,
    Width=width_25,
    Height=height_24,
    HorizontalAlignment=Slider(0, range=0..100))
adjustpos_25 = AdjustElementPositioning(ElementsToAdjust=checkbox, Margin="10,5,0,10", AbsolutePositioning=False, Width=width_26, Height=height_25)
stack = CreateStack(UIElements=merge, Horizontal=Toggle(False))
adjustpos_26 = AdjustElementPositioning(
    ElementsToAdjust=button_11,
    Margin="230,-45,0,10",
    AbsolutePositioning=False,
    Width=width_27,
    Height=height_26,
    HorizontalAlignment=Slider(0, range=0..100))
hideshow = HideShowElement(ElementToHideShow=stack, Show=motionselection.InsTransPanel, Collapse=Toggle(True), Disable=Toggle(False))

# ---- group: Instant Rotation Kinetic Unit
height_27 = Slider(30, range=0..30)
width_28 = Slider(186, range=0..400)
width_29 = Slider(300, range=0..1000)
width_30 = Slider(300, range=0..1000)
height_28 = Slider(35, range=0..1000)
height_29 = Slider(35, range=0..1000)
width_31 = Slider(300, range=0..1000)
height_30 = Slider(35, range=0..1000)
height_31 = Slider(30, range=0..30)
width_32 = Slider(50, range=0..400)
label_10 = CreateLabel(LabelText="Motion characteristics:", LabelSize=12, Justification=0)
adjustelem_8 = AdjustElementAppearance(ElementsToAdjust=label_10, Background="255,255,255")
adjustpos_27 = AdjustElementPositioning(
    ElementsToAdjust=label_10,
    Margin="5,5,0,0",
    AbsolutePositioning=False,
    Width=width_28,
    Height=height_27,
    HorizontalAlignment=Slider(0, range=0..100))
button_12 = CreateButton(ButtonName="Step 3: select the end-effector", ButtonStyle=0)
button_13 = CreateButton(ButtonName="Step 2: select the rotation axis", ButtonStyle=0)
button_14 = CreateButton(ButtonName="Step 1: select the target body  for embedding the unit", ButtonStyle=0)
label_11 = CreateLabel(LabelText="Max", LabelSize=12, Justification=0)
adjustpos_28 = AdjustElementPositioning(
    ElementsToAdjust=label_11,
    Margin="280,-50,0,5",
    AbsolutePositioning=False,
    Width=width_32,
    Height=height_31,
    HorizontalAlignment=Slider(0, range=0..100))
adjustelem_9 = AdjustElementAppearance(ElementsToAdjust=label_11, Background="255,255,255")
adjustpos_29 = AdjustElementPositioning(
    ElementsToAdjust=button_14,
    Margin="10,-10,0,10",
    AbsolutePositioning=False,
    Width=width_31,
    Height=height_30,
    HorizontalAlignment=Slider(0, range=0..100))
adjustpos_30 = AdjustElementPositioning(
    ElementsToAdjust=button_12,
    Margin="10,5,0,10",
    AbsolutePositioning=False,
    Width=width_29,
    Height=height_28,
    HorizontalAlignment=Slider(0, range=0..100))
adjustpos_31 = AdjustElementPositioning(
    ElementsToAdjust=button_13,
    Margin="10,5,0,10",
    AbsolutePositioning=False,
    Width=width_30,
    Height=height_29,
    HorizontalAlignment=Slider(0, range=0..100))
torsion_min = Slider(4, range=0..9)
colour_3 = ColourPicker(PickedColour=RGB(51, 121, 200))
width_33 = Slider(295, range=0..400)
height_32 = Slider(30, range=0..30)
width_34 = Slider(305, range=0..400)
height_33 = Slider(30, range=0..30)
titlesize_3 = Slider(15, range=0..30)
slider_4 = CreateSlider(Slider=torsion_min, ShowBounds=False, ShowTicks=False, ShowTooltip=False, ShowValLabel=True, showLabel=True)
textbox = CreateTextBox(Label="Max rotation angle (0°-360°):", UpdateButton=Toggle(False), showLabel=True)
width_35 = Slider(566, range=0..1000)
height_34 = Slider(38, range=0..1000)
adjustpos_32 = AdjustElementPositioning(
    ElementsToAdjust=slider_4,
    Margin="5,5,0,10",
    AbsolutePositioning=False,
    Width=width_33,
    Height=height_32,
    HorizontalAlignment=Slider(0, range=0..100))
adjustpos_33 = AdjustElementPositioning(
    ElementsToAdjust=textbox,
    Margin="5,0,0,5",
    AbsolutePositioning=False,
    Width=width_34,
    Height=height_33,
    HorizontalAlignment=Slider(0, range=0..100))
colour_4 = ColourPicker(PickedColour=RGB(230, 230, 230))
separatorheight_2 = Slider(10, range=0..10)
width_36 = Slider(400, range=0..1000)
label_12 = CreateLabel(LabelText="Instant Rotation Kinetic Unit", LabelSize=12, Justification=0)
adjustelem_10 = AdjustElementAppearance(ElementsToAdjust=label_12, Foreground=colour_3, FontSize=titlesize_3)
adjustpos_34 = AdjustElementPositioning(
    ElementsToAdjust=label_12,
    Margin="0,5,0,10",
    AbsolutePositioning=False,
    Width=width_35,
    Height=height_34,
    HorizontalAlignment=Slider(0, range=0..100))
true_button_2 = CreateTrueOnlyButton(ButtonName="Preview", ButtonStyle=0)
width_37 = Slider(80, range=0..1000)
height_35 = Slider(30, range=0..1000)
width_38 = Slider(450, range=0..1000)
checkbox_2 = CreateCheckbox(Label="Add a lock", StartingValue=False)
height_36 = Slider(35, range=0..1000)
width_39 = Slider(80, range=0..1000)
height_37 = Slider(30, range=0..1000)
button_15 = CreateButton(ButtonName="Finish", ButtonStyle=0)
separator_2 = CreateSeparator(Thickness=0.5, Horizontal=True, Color=colour_4, Width=width_36, Height=separatorheight_2)
merge_2 = Merge(
    Data2=label_12,
    Data3=button_14,
    Data4=button_13,
    Data5=button_12,
    Data6=label_10,
    Data7=slider_4,
    Data8=label_11,
    Data9=textbox,
    Data10=separator_2,
    Data11=checkbox_2,
    Data12=true_button_2,
    Data13=button_15)
adjustpos_35 = AdjustElementPositioning(
    ElementsToAdjust=true_button_2,
    Margin="150,-45,0,10",
    AbsolutePositioning=False,
    Width=width_37,
    Height=height_35,
    HorizontalAlignment=Slider(0, range=0..100))
adjustpos_36 = AdjustElementPositioning(ElementsToAdjust=checkbox_2, Margin="15,15,0,10", AbsolutePositioning=False, Width=width_38, Height=height_36)
stack_2 = CreateStack(UIElements=merge_2, Horizontal=Toggle(False))
adjustpos_37 = AdjustElementPositioning(
    ElementsToAdjust=button_15,
    Margin="240,-45,0,10",
    AbsolutePositioning=False,
    Width=width_39,
    Height=height_37,
    HorizontalAlignment=Slider(0, range=0..100))
hideshow_2 = HideShowElement(ElementToHideShow=stack_2, Show=motionselection.InsRotationPanel, Collapse=Toggle(True), Disable=Toggle(False))

# ---- group: Intermittent Oscillation Control Panel
height_38 = Slider(30, range=0..30)
width_40 = Slider(50, range=0..400)
label_13 = CreateLabel(LabelText="Fastest", LabelSize=12, Justification=0)
adjustpos_38 = AdjustElementPositioning(
    ElementsToAdjust=label_13,
    Margin="286,-45,0,5",
    AbsolutePositioning=False,
    Width=width_40,
    Height=height_38,
    HorizontalAlignment=Slider(0, range=0..100))
adjustelem_11 = AdjustElementAppearance(ElementsToAdjust=label_13, Background="255,255,255")
height_39 = Slider(34, range=0..1000)
width_41 = Slider(110, range=0..1000)
width_42 = Slider(80, range=0..1000)
height_40 = Slider(30, range=0..1000)
c_script_8 = CSharpScript()  # -> out, A; same code as c_script
python_8 = GhPythonScript(x=c_script_8.A)  # -> a; same code as python_4
height_41 = Slider(30, range=0..30)
width_43 = Slider(40, range=0..400)
width_44 = Slider(150, range=0..1000)
height_42 = Slider(80, range=0..1000)
panel_10 = Panel("""Slow
Regular
Fast""")
width_45 = Slider(117, range=0..1000)
height_43 = Slider(112, range=0..1000)
panel_11 = Panel(python_8)
label_14 = CreateLabel(LabelText="Max", LabelSize=12, Justification=0)
pulldown_3 = CreatePulldownMenu(Label="Amp", ListItems=panel_10, showLabel=True)
button_16 = CreateButton(ButtonName="Set the input", ButtonStyle=0)
adjustpos_39 = AdjustElementPositioning(
    ElementsToAdjust=label_14,
    Margin="181,-55,0,5",
    AbsolutePositioning=False,
    Width=width_43,
    Height=height_41,
    HorizontalAlignment=Slider(0, range=0..100))
adjustelem_12 = AdjustElementAppearance(ElementsToAdjust=label_14, Background="255,255,255")
adjustpos_40 = AdjustElementPositioning(
    ElementsToAdjust=pulldown_3,
    Margin="216,-45,0,10",
    AbsolutePositioning=False,
    Width=width_41,
    Height=height_39,
    HorizontalAlignment=Slider(0, range=0..100))
adjustpos_41 = AdjustElementPositioning(
    ElementsToAdjust=button_16,
    Margin="10,-40,0,10",
    AbsolutePositioning=False,
    Width=width_42,
    Height=height_40,
    HorizontalAlignment=Slider(0, range=0..100))
image = CreateImage(ImageSource=panel_11, ImageWidth=width_45, ImageHeight=height_43)
adjustpos_42 = AdjustElementPositioning(
    ElementsToAdjust=image,
    Margin="240,-90,0,10",
    AbsolutePositioning=False,
    Width=width_44,
    Height=height_42,
    HorizontalAlignment=Slider(0, range=0..100))
separatorheight_3 = Slider(4, range=0..10)
strength = Slider(4, range=0..9)
colour_5 = ColourPicker(PickedColour=RGB(230, 230, 230))
speed_2 = Slider(2, range=0..4)
width_46 = Slider(210, range=0..1000)
height_44 = Slider(30, range=0..1000)
width_47 = Slider(200, range=0..400)
height_45 = Slider(30, range=0..30)
width_48 = Slider(210, range=0..1000)
height_46 = Slider(30, range=0..1000)
width_49 = Slider(305, range=0..400)
height_47 = Slider(30, range=0..30)
titlesize_4 = Slider(18, range=0..30)
separator_3 = CreateSeparator(Thickness=0.5, Horizontal=True, Color=colour_5, Height=separatorheight_3)
colour_6 = ColourPicker(PickedColour=RGB(51, 121, 200))
button_17 = CreateButton(ButtonName="Select the end-effector", ButtonStyle=0)
slider_5 = CreateSlider(Slider=strength, ShowBounds=False, ShowTicks=False, ShowTooltip=False, ShowValLabel=True, showLabel=True)
slider_6 = CreateSlider(Slider=speed_2, ShowBounds=False, ShowTicks=False, ShowTooltip=False, ShowValLabel=True, showLabel=True)
button_18 = CreateButton(ButtonName="Select the region and axis", ButtonStyle=0)
width_50 = Slider(566, range=0..1000)
height_48 = Slider(38, range=0..1000)
adjustpos_43 = AdjustElementPositioning(
    ElementsToAdjust=slider_5,
    Margin="5,20,0,10",
    AbsolutePositioning=False,
    Width=width_47,
    Height=height_45,
    HorizontalAlignment=Slider(0, range=0..100))
adjustpos_44 = AdjustElementPositioning(
    ElementsToAdjust=button_17,
    Margin="10,5,0,10",
    AbsolutePositioning=False,
    Width=width_46,
    Height=height_44,
    HorizontalAlignment=Slider(0, range=0..100))
adjustpos_45 = AdjustElementPositioning(
    ElementsToAdjust=slider_6,
    Margin="5,10,0,5",
    AbsolutePositioning=False,
    Width=width_49,
    Height=height_47,
    HorizontalAlignment=Slider(0, range=0..100))
adjustpos_46 = AdjustElementPositioning(
    ElementsToAdjust=button_18,
    Margin="10,0,0,10",
    AbsolutePositioning=False,
    Width=width_48,
    Height=height_46,
    HorizontalAlignment=Slider(0, range=0..100))
colour_7 = ColourPicker(PickedColour=RGB(230, 230, 230))
separatorheight_4 = Slider(10, range=0..10)
true_button_3 = CreateTrueOnlyButton(ButtonName="Preview", ButtonStyle=0)
width_51 = Slider(400, range=0..1000)
label_15 = CreateLabel(LabelText="Kinetic Unit for Intermittent Oscillation", LabelSize=12, Justification=0)
adjustelem_13 = AdjustElementAppearance(ElementsToAdjust=label_15, Foreground=colour_6, FontSize=titlesize_4)
adjustpos_47 = AdjustElementPositioning(
    ElementsToAdjust=label_15,
    Margin="0,5,0,10",
    AbsolutePositioning=False,
    Width=width_50,
    Height=height_48,
    HorizontalAlignment=Slider(0, range=0..100))
width_52 = Slider(80, range=0..1000)
height_49 = Slider(30, range=0..1000)
checkbox_3 = CreateCheckbox(Label="Add a lock", StartingValue=False)
width_53 = Slider(450, range=0..1000)
width_54 = Slider(80, range=0..1000)
height_50 = Slider(30, range=0..1000)
height_51 = Slider(35, range=0..1000)
button_19 = CreateButton(ButtonName="Finish", ButtonStyle=0)
separator_4 = CreateSeparator(Thickness=0.5, Horizontal=True, Color=colour_7, Width=width_51, Height=separatorheight_4)
merge_3 = Merge(
    Data1=separator_3,
    Data2=label_15,
    Data3=button_18,
    Data4=button_17,
    Data5=image,
    Data7=slider_5,
    Data8=pulldown_3,
    Data9=label_14,
    Data10=slider_6,
    Data11=label_13,
    Data13=separator_4,
    Data14=checkbox_3,
    Data15=true_button_3,
    Data16=button_19)
adjustpos_48 = AdjustElementPositioning(
    ElementsToAdjust=true_button_3,
    Margin="150,-45,0,10",
    AbsolutePositioning=False,
    Width=width_52,
    Height=height_49,
    HorizontalAlignment=Slider(0, range=0..100))
stack_3 = CreateStack(UIElements=merge_3, Horizontal=Toggle(False))
adjustpos_49 = AdjustElementPositioning(
    ElementsToAdjust=button_19,
    Margin="240,-45,0,10",
    AbsolutePositioning=False,
    Width=width_54,
    Height=height_50,
    HorizontalAlignment=Slider(0, range=0..100))
adjustpos_50 = AdjustElementPositioning(ElementsToAdjust=checkbox_3, Margin="15,15,0,10", AbsolutePositioning=False, Width=width_53, Height=height_51)
hideshow_3 = HideShowElement(ElementToHideShow=stack_3, Show=motionselection.InterOscillationPanel, Collapse=Toggle(True), Disable=Toggle(False))

# ---- group: Reciprocation Control Panel
height_52 = Slider(30, range=0..30)
width_55 = Slider(50, range=0..400)
label_16 = CreateLabel(LabelText="Fastest", LabelSize=12, Justification=0)
adjustpos_51 = AdjustElementPositioning(
    ElementsToAdjust=label_16,
    Margin="181,-45,0,5",
    AbsolutePositioning=False,
    Width=width_55,
    Height=height_52,
    HorizontalAlignment=Slider(0, range=0..100))
adjustelem_14 = AdjustElementAppearance(ElementsToAdjust=label_16, Background="255,255,255")
height_53 = Slider(34, range=0..1000)
width_56 = Slider(110, range=0..1000)
width_57 = Slider(80, range=0..1000)
height_54 = Slider(30, range=0..1000)
panel_12 = Panel("""Uniform acceleration & deceleration
Slightly rising & suddenly falling""")
c_script_9 = CSharpScript()  # -> out, A; same code as c_script
height_55 = Slider(30, range=0..30)
width_58 = Slider(35, range=0..400)
python_9 = GhPythonScript(x=c_script_9.A)  # -> a; same code as python_2
pulldown_4 = CreatePulldownMenu(Label="Pattern", ListItems=panel_12, showLabel=True)
width_59 = Slider(150, range=0..1000)
height_56 = Slider(80, range=0..1000)
width_60 = Slider(117, range=0..1000)
height_57 = Slider(112, range=0..1000)
label_17 = CreateLabel(LabelText="Max", LabelSize=12, Justification=0)
panel_13 = Panel(python_9)
button_20 = CreateButton(ButtonName="Set the input", ButtonStyle=0)
adjustpos_52 = AdjustElementPositioning(
    ElementsToAdjust=pulldown_4,
    Margin="218,-45,0,10",
    AbsolutePositioning=False,
    Width=width_56,
    Height=height_53,
    HorizontalAlignment=Slider(0, range=0..100))
adjustpos_53 = AdjustElementPositioning(
    ElementsToAdjust=label_17,
    Margin="181,-55,0,5",
    AbsolutePositioning=False,
    Width=width_58,
    Height=height_55,
    HorizontalAlignment=Slider(0, range=0..100))
adjustelem_15 = AdjustElementAppearance(ElementsToAdjust=label_17, Background="255,255,255")
adjustpos_54 = AdjustElementPositioning(
    ElementsToAdjust=button_20,
    Margin="10,-40,0,10",
    AbsolutePositioning=False,
    Width=width_57,
    Height=height_54,
    HorizontalAlignment=Slider(0, range=0..100))
image_2 = CreateImage(ImageSource=panel_13, ImageWidth=width_60, ImageHeight=height_57)
adjustpos_55 = AdjustElementPositioning(
    ElementsToAdjust=image_2,
    Margin="240,-90,0,10",
    AbsolutePositioning=False,
    Width=width_59,
    Height=height_56,
    HorizontalAlignment=Slider(0, range=0..100))
separatorheight_5 = Slider(4, range=0..10)
strength_2 = Slider(4, range=0..9)
colour_8 = ColourPicker(PickedColour=RGB(230, 230, 230))
speed_3 = Slider(2, range=0..4)
width_61 = Slider(210, range=0..1000)
height_58 = Slider(30, range=0..1000)
width_62 = Slider(200, range=0..400)
height_59 = Slider(30, range=0..30)
width_63 = Slider(210, range=0..1000)
height_60 = Slider(30, range=0..1000)
width_64 = Slider(180, range=0..400)
height_61 = Slider(30, range=0..30)
titlesize_5 = Slider(18, range=0..30)
separator_5 = CreateSeparator(Thickness=0.5, Horizontal=True, Color=colour_8, Height=separatorheight_5)
colour_9 = ColourPicker(PickedColour=RGB(51, 121, 200))
button_21 = CreateButton(ButtonName="Select the end-effector", ButtonStyle=0)
slider_7 = CreateSlider(Slider=strength_2, ShowBounds=False, ShowTicks=False, ShowTooltip=False, ShowValLabel=True, showLabel=True)
slider_8 = CreateSlider(Slider=speed_3, ShowBounds=False, ShowTicks=False, ShowTooltip=False, ShowValLabel=True, showLabel=True)
button_22 = CreateButton(ButtonName="Select the region and direction", ButtonStyle=0)
width_65 = Slider(566, range=0..1000)
height_62 = Slider(38, range=0..1000)
adjustpos_56 = AdjustElementPositioning(
    ElementsToAdjust=slider_7,
    Margin="5,20,0,10",
    AbsolutePositioning=False,
    Width=width_62,
    Height=height_59,
    HorizontalAlignment=Slider(0, range=0..100))
adjustpos_57 = AdjustElementPositioning(
    ElementsToAdjust=button_21,
    Margin="10,5,0,10",
    AbsolutePositioning=False,
    Width=width_61,
    Height=height_58,
    HorizontalAlignment=Slider(0, range=0..100))
adjustpos_58 = AdjustElementPositioning(
    ElementsToAdjust=slider_8,
    Margin="5,10,0,5",
    AbsolutePositioning=False,
    Width=width_64,
    Height=height_61,
    HorizontalAlignment=Slider(0, range=0..100))
adjustpos_59 = AdjustElementPositioning(
    ElementsToAdjust=button_22,
    Margin="10,0,0,10",
    AbsolutePositioning=False,
    Width=width_63,
    Height=height_60,
    HorizontalAlignment=Slider(0, range=0..100))
colour_10 = ColourPicker(PickedColour=RGB(230, 230, 230))
separatorheight_6 = Slider(10, range=0..10)
true_button_4 = CreateTrueOnlyButton(ButtonName="Preview", ButtonStyle=0)
width_66 = Slider(400, range=0..1000)
label_18 = CreateLabel(LabelText="Kinetic Unit for Reciprocation", LabelSize=12, Justification=0)
adjustelem_16 = AdjustElementAppearance(ElementsToAdjust=label_18, Foreground=colour_9, FontSize=titlesize_5)
adjustpos_60 = AdjustElementPositioning(
    ElementsToAdjust=label_18,
    Margin="0,5,0,10",
    AbsolutePositioning=False,
    Width=width_65,
    Height=height_62,
    HorizontalAlignment=Slider(0, range=0..100))
width_67 = Slider(80, range=0..1000)
height_63 = Slider(30, range=0..1000)
checkbox_4 = CreateCheckbox(Label="Add a lock", StartingValue=False)
width_68 = Slider(450, range=0..1000)
height_64 = Slider(35, range=0..1000)
width_69 = Slider(80, range=0..1000)
height_65 = Slider(30, range=0..1000)
button_23 = CreateButton(ButtonName="Finish", ButtonStyle=0)
separator_6 = CreateSeparator(Thickness=0.5, Horizontal=True, Color=colour_10, Width=width_66, Height=separatorheight_6)
merge_4 = Merge(
    Data1=separator_5,
    Data2=label_18,
    Data3=button_22,
    Data4=button_21,
    Data5=image_2,
    Data7=slider_7,
    Data8=pulldown_2,
    Data9=label_17,
    Data10=slider_8,
    Data11=label_16,
    Data12=pulldown_4,
    Data13=separator_6,
    Data14=checkbox_4,
    Data15=true_button_4,
    Data16=button_23)
adjustpos_61 = AdjustElementPositioning(
    ElementsToAdjust=true_button_4,
    Margin="150,-45,0,10",
    AbsolutePositioning=False,
    Width=width_67,
    Height=height_63,
    HorizontalAlignment=Slider(0, range=0..100))
stack_4 = CreateStack(UIElements=merge_4, Horizontal=Toggle(False))
adjustpos_62 = AdjustElementPositioning(
    ElementsToAdjust=button_23,
    Margin="240,-45,0,10",
    AbsolutePositioning=False,
    Width=width_69,
    Height=height_65,
    HorizontalAlignment=Slider(0, range=0..100))
adjustpos_63 = AdjustElementPositioning(ElementsToAdjust=checkbox_4, Margin="15,15,0,10", AbsolutePositioning=False, Width=width_68, Height=height_64)
hideshow_4 = HideShowElement(ElementToHideShow=stack_4, Show=motionselection.RecipPanel, Collapse=Toggle(True), Disable=Toggle(False))

# ---- group: Continuous Translation Control Panel
height_66 = Slider(30, range=0..30)
width_70 = Slider(80, range=0..1000)
height_67 = Slider(30, range=0..1000)
width_71 = Slider(50, range=0..400)
height_68 = Slider(30, range=0..30)
width_72 = Slider(50, range=0..400)
c_script_10 = CSharpScript()  # -> out, A; same code as c_script
python_10 = GhPythonScript(x=c_script_10.A)  # -> a; same code as python_7
width_73 = Slider(150, range=0..1000)
height_69 = Slider(80, range=0..1000)
label_19 = CreateLabel(LabelText="Fastest", LabelSize=12, Justification=0)
label_20 = CreateLabel(LabelText="Max", LabelSize=12, Justification=0)
width_74 = Slider(117, range=0..1000)
height_70 = Slider(112, range=0..1000)
panel_14 = Panel(python_10)
button_24 = CreateButton(ButtonName="Set the input", ButtonStyle=0)
adjustpos_64 = AdjustElementPositioning(
    ElementsToAdjust=label_19,
    Margin="181,-45,0,5",
    AbsolutePositioning=False,
    Width=width_71,
    Height=height_66,
    HorizontalAlignment=Slider(0, range=0..100))
adjustelem_17 = AdjustElementAppearance(ElementsToAdjust=label_19, Background="255,255,255")
adjustpos_65 = AdjustElementPositioning(
    ElementsToAdjust=label_20,
    Margin="290,-55,0,5",
    AbsolutePositioning=False,
    Width=width_72,
    Height=height_68,
    HorizontalAlignment=Slider(0, range=0..100))
adjustelem_18 = AdjustElementAppearance(ElementsToAdjust=label_20, Background="255,255,255")
adjustpos_66 = AdjustElementPositioning(
    ElementsToAdjust=button_24,
    Margin="10,-40,0,10",
    AbsolutePositioning=False,
    Width=width_70,
    Height=height_67,
    HorizontalAlignment=Slider(0, range=0..100))
image_3 = CreateImage(ImageSource=panel_14, ImageWidth=width_74, ImageHeight=height_70)
adjustpos_67 = AdjustElementPositioning(
    ElementsToAdjust=image_3,
    Margin="240,-90,0,10",
    AbsolutePositioning=False,
    Width=width_73,
    Height=height_69,
    HorizontalAlignment=Slider(0, range=0..100))
separatorheight_7 = Slider(4, range=0..10)
strength_3 = Slider(4, range=0..9)
colour_11 = ColourPicker(PickedColour=RGB(230, 230, 230))
speed_4 = Slider(3, range=0..9)
width_75 = Slider(210, range=0..1000)
height_71 = Slider(30, range=0..1000)
width_76 = Slider(305, range=0..400)
height_72 = Slider(30, range=0..30)
width_77 = Slider(210, range=0..1000)
height_73 = Slider(30, range=0..1000)
width_78 = Slider(138, range=0..400)
height_74 = Slider(30, range=0..30)
titlesize_6 = Slider(18, range=0..30)
separator_7 = CreateSeparator(Thickness=0.5, Horizontal=True, Color=colour_11, Height=separatorheight_7)
colour_12 = ColourPicker(PickedColour=RGB(51, 121, 200))
slider_9 = CreateSlider(Slider=strength_3, ShowBounds=False, ShowTicks=False, ShowTooltip=False, ShowValLabel=True, showLabel=True)
slider_10 = CreateSlider(Slider=speed_4, ShowBounds=False, ShowTicks=False, ShowTooltip=False, ShowValLabel=True, showLabel=True)
button_25 = CreateButton(ButtonName="Select the end-effector", ButtonStyle=0)
button_26 = CreateButton(ButtonName="Select the region and direction", ButtonStyle=0)
width_79 = Slider(566, range=0..1000)
height_75 = Slider(38, range=0..1000)
adjustpos_68 = AdjustElementPositioning(
    ElementsToAdjust=slider_9,
    Margin="5,20,0,10",
    AbsolutePositioning=False,
    Width=width_76,
    Height=height_72,
    HorizontalAlignment=Slider(0, range=0..100))
adjustpos_69 = AdjustElementPositioning(
    ElementsToAdjust=button_25,
    Margin="10,5,0,10",
    AbsolutePositioning=False,
    Width=width_75,
    Height=height_71,
    HorizontalAlignment=Slider(0, range=0..100))
adjustpos_70 = AdjustElementPositioning(
    ElementsToAdjust=slider_10,
    Margin="5,10,0,5",
    AbsolutePositioning=False,
    Width=width_78,
    Height=height_74,
    HorizontalAlignment=Slider(0, range=0..100))
adjustpos_71 = AdjustElementPositioning(
    ElementsToAdjust=button_26,
    Margin="10,0,0,10",
    AbsolutePositioning=False,
    Width=width_77,
    Height=height_73,
    HorizontalAlignment=Slider(0, range=0..100))
colour_13 = ColourPicker(PickedColour=RGB(230, 230, 230))
height_76 = Slider(35, range=0..1000)
separatorheight_8 = Slider(10, range=0..10)
true_button_5 = CreateTrueOnlyButton(ButtonName="Preview", ButtonStyle=0)
width_80 = Slider(400, range=0..1000)
label_21 = CreateLabel(LabelText="Kinetic Unit for Continuous Translation", LabelSize=12, Justification=0)
adjustelem_19 = AdjustElementAppearance(ElementsToAdjust=label_21, Foreground=colour_12, FontSize=titlesize_6)
adjustpos_72 = AdjustElementPositioning(
    ElementsToAdjust=label_21,
    Margin="0,5,0,10",
    AbsolutePositioning=False,
    Width=width_79,
    Height=height_75,
    HorizontalAlignment=Slider(0, range=0..100))
width_81 = Slider(450, range=0..1000)
width_82 = Slider(80, range=0..1000)
height_77 = Slider(30, range=0..1000)
checkbox_5 = CreateCheckbox(Label="Add a lock", StartingValue=False)
width_83 = Slider(80, range=0..1000)
height_78 = Slider(30, range=0..1000)
button_27 = CreateButton(ButtonName="Finish", ButtonStyle=0)
separator_8 = CreateSeparator(Thickness=0.5, Horizontal=True, Color=colour_13, Width=width_80, Height=separatorheight_8)
merge_5 = Merge(
    Data1=separator_7,
    Data2=label_21,
    Data3=button_26,
    Data4=button_25,
    Data5=image_3,
    Data7=slider_9,
    Data8=label_20,
    Data9=slider_10,
    Data10=pulldown,
    Data11=label_19,
    Data12=separator_8,
    Data13=checkbox_5,
    Data14=true_button_5,
    Data15=button_27)
adjustpos_73 = AdjustElementPositioning(ElementsToAdjust=checkbox_5, Margin="15,15,0,10", AbsolutePositioning=False, Width=width_81, Height=height_76)
adjustpos_74 = AdjustElementPositioning(
    ElementsToAdjust=true_button_5,
    Margin="150,-45,0,10",
    AbsolutePositioning=False,
    Width=width_82,
    Height=height_77,
    HorizontalAlignment=Slider(0, range=0..100))
stack_5 = CreateStack(UIElements=merge_5, Horizontal=Toggle(False))
adjustpos_75 = AdjustElementPositioning(
    ElementsToAdjust=button_27,
    Margin="240,-45,0,10",
    AbsolutePositioning=False,
    Width=width_83,
    Height=height_78,
    HorizontalAlignment=Slider(0, range=0..100))
hideshow_5 = HideShowElement(ElementToHideShow=stack_5, Show=motionselection.ConTransPanel, Collapse=Toggle(True), Disable=Toggle(False))

# ---- group: Intermittent Rotation Control Panel
width_84 = Slider(80, range=0..1000)
height_79 = Slider(30, range=0..1000)
height_80 = Slider(34, range=0..1000)
width_85 = Slider(140, range=0..1000)
c_script_11 = CSharpScript()  # -> out, A; same code as c_script
height_81 = Slider(30, range=0..30)
width_86 = Slider(50, range=0..400)
python_11 = GhPythonScript(x=c_script_11.A)  # -> a; same code as python_6
height_82 = Slider(80, range=0..1000)
width_87 = Slider(150, range=0..1000)
width_88 = Slider(117, range=0..1000)
height_83 = Slider(112, range=0..1000)
panel_15 = Panel(python_11)
label_22 = CreateLabel(LabelText="Max", LabelSize=12, Justification=0)
textbox_2 = CreateTextBox(Label="Step angle:", UpdateButton=Toggle(False), showLabel=True)
button_28 = CreateButton(ButtonName="Set the input", ButtonStyle=0)
adjustpos_76 = AdjustElementPositioning(
    ElementsToAdjust=label_22,
    Margin="290,-55,0,5",
    AbsolutePositioning=False,
    Width=width_86,
    Height=height_81,
    HorizontalAlignment=Slider(0, range=0..100))
adjustelem_20 = AdjustElementAppearance(ElementsToAdjust=label_22, Background="255,255,255")
adjustpos_77 = AdjustElementPositioning(
    ElementsToAdjust=button_28,
    Margin="10,-40,0,10",
    AbsolutePositioning=False,
    Width=width_84,
    Height=height_79,
    HorizontalAlignment=Slider(0, range=0..100))
adjustpos_78 = AdjustElementPositioning(
    ElementsToAdjust=slider,
    Margin="110,-65,0,0",
    AbsolutePositioning=False,
    Width=width_85,
    Height=height_80,
    HorizontalAlignment=Slider(0, range=0..100))
image_4 = CreateImage(ImageSource=panel_15, ImageWidth=width_88, ImageHeight=height_83)
adjustpos_79 = AdjustElementPositioning(
    ElementsToAdjust=image_4,
    Margin="240,-90,0,10",
    AbsolutePositioning=False,
    Width=width_87,
    Height=height_82,
    HorizontalAlignment=Slider(0, range=0..100))
colour_14 = ColourPicker(PickedColour=RGB(230, 230, 230))
separatorheight_9 = Slider(4, range=0..10)
strength_4 = Slider(4, range=0..9)
width_89 = Slider(210, range=0..1000)
height_84 = Slider(30, range=0..1000)
width_90 = Slider(305, range=0..400)
height_85 = Slider(30, range=0..30)
width_91 = Slider(210, range=0..1000)
height_86 = Slider(30, range=0..1000)
colour_15 = ColourPicker(PickedColour=RGB(51, 121, 200))
width_92 = Slider(100, range=0..400)
height_87 = Slider(30, range=0..30)
titlesize_7 = Slider(18, range=0..30)
colour_16 = ColourPicker(PickedColour=RGB(230, 230, 230))
separator_9 = CreateSeparator(Thickness=0.5, Horizontal=True, Color=colour_14, Height=separatorheight_9)
button_29 = CreateButton(ButtonName="Select the end-effector", ButtonStyle=0)
slider_11 = CreateSlider(Slider=strength_4, ShowBounds=False, ShowTicks=False, ShowTooltip=False, ShowValLabel=True, showLabel=True)
button_30 = CreateButton(ButtonName="Select the region and axis", ButtonStyle=0)
width_93 = Slider(566, range=0..1000)
height_88 = Slider(38, range=0..1000)
adjustpos_80 = AdjustElementPositioning(
    ElementsToAdjust=slider_11,
    Margin="5,20,0,10",
    AbsolutePositioning=False,
    Width=width_90,
    Height=height_85,
    HorizontalAlignment=Slider(0, range=0..100))
adjustpos_81 = AdjustElementPositioning(
    ElementsToAdjust=button_29,
    Margin="10,5,0,10",
    AbsolutePositioning=False,
    Width=width_89,
    Height=height_84,
    HorizontalAlignment=Slider(0, range=0..100))
adjustpos_82 = AdjustElementPositioning(
    ElementsToAdjust=textbox_2,
    Margin="5,0,0,5",
    AbsolutePositioning=False,
    Width=width_92,
    Height=height_87,
    HorizontalAlignment=Slider(0, range=0..100))
adjustpos_83 = AdjustElementPositioning(
    ElementsToAdjust=button_30,
    Margin="10,0,0,10",
    AbsolutePositioning=False,
    Width=width_91,
    Height=height_86,
    HorizontalAlignment=Slider(0, range=0..100))
separatorheight_10 = Slider(10, range=0..10)
true_button_6 = CreateTrueOnlyButton(ButtonName="Preview", ButtonStyle=0)
width_94 = Slider(400, range=0..1000)
label_23 = CreateLabel(LabelText="Kinetic Unit for Intermittent Rotation", LabelSize=12, Justification=0)
adjustelem_21 = AdjustElementAppearance(ElementsToAdjust=label_23, Foreground=colour_15, FontSize=titlesize_7)
adjustpos_84 = AdjustElementPositioning(
    ElementsToAdjust=label_23,
    Margin="0,5,0,10",
    AbsolutePositioning=False,
    Width=width_93,
    Height=height_88,
    HorizontalAlignment=Slider(0, range=0..100))
width_95 = Slider(80, range=0..1000)
height_89 = Slider(30, range=0..1000)
separator_10 = CreateSeparator(Thickness=0.5, Horizontal=True, Color=colour_16, Width=width_94, Height=separatorheight_10)
checkbox_6 = CreateCheckbox(Label="Add a lock", StartingValue=False)
button_31 = CreateButton(ButtonName="Preview", ButtonStyle=0)
height_90 = Slider(35, range=0..1000)
width_96 = Slider(450, range=0..1000)
width_97 = Slider(80, range=0..1000)
height_91 = Slider(30, range=0..1000)
button_32 = CreateButton(ButtonName="Finish", ButtonStyle=0)
merge_6 = Merge(
    Data1=separator_9,
    Data2=label_23,
    Data3=button_30,
    Data4=button_29,
    Data5=image_4,
    Data7=slider_11,
    Data8=label_22,
    Data9=textbox_2,
    Data10=label_4,
    Data11=slider,
    Data12=label_5,
    Data13=separator_10,
    Data14=checkbox_6,
    Data15=true_button_6,
    Data16=button_32)
adjustpos_85 = AdjustElementPositioning(
    ElementsToAdjust=true_button_6,
    Margin="150,-45,0,10",
    AbsolutePositioning=False,
    Width=width_95,
    Height=height_89,
    HorizontalAlignment=Slider(0, range=0..100))
stack_6 = CreateStack(UIElements=merge_6, Horizontal=Toggle(False))
adjustpos_86 = AdjustElementPositioning(ElementsToAdjust=checkbox_6, Margin="15,10,0,10", AbsolutePositioning=False, Width=width_96, Height=height_90)
adjustpos_87 = AdjustElementPositioning(
    ElementsToAdjust=button_32,
    Margin="240,-45,0,10",
    AbsolutePositioning=False,
    Width=width_97,
    Height=height_91,
    HorizontalAlignment=Slider(0, range=0..100))
hideshow_6 = HideShowElement(ElementToHideShow=stack_6, Show=motionselection.InterRotPanel, Collapse=Toggle(True), Disable=Toggle(False))

# ---- group: Continuous Rotation Control Panel
width_98 = Slider(80, range=0..1000)
height_92 = Slider(30, range=0..1000)
height_93 = Slider(30, range=0..30)
width_99 = Slider(50, range=0..400)
c_script_12 = CSharpScript()  # -> out, A; same code as c_script
python_12 = GhPythonScript(x=c_script_12.A)  # -> a; same code as python
height_94 = Slider(30, range=0..30)
width_100 = Slider(50, range=0..400)
width_101 = Slider(150, range=0..1000)
height_95 = Slider(80, range=0..1000)
label_24 = CreateLabel(LabelText="Max", LabelSize=12, Justification=0)
width_102 = Slider(117, range=0..1000)
height_96 = Slider(112, range=0..1000)
panel_16 = Panel(python_12)
button_33 = CreateButton(ButtonName="Set the input", ButtonStyle=0)
label_25 = CreateLabel(LabelText="Fastest", LabelSize=12, Justification=0)
adjustpos_88 = AdjustElementPositioning(
    ElementsToAdjust=label_24,
    Margin="287,-55,0,5",
    AbsolutePositioning=False,
    Width=width_99,
    Height=height_93,
    HorizontalAlignment=Slider(0, range=0..100))
adjustelem_22 = AdjustElementAppearance(ElementsToAdjust=label_24, Background="255,255,255")
adjustpos_89 = AdjustElementPositioning(
    ElementsToAdjust=button_33,
    Margin="10,-40,0,10",
    AbsolutePositioning=False,
    Width=width_98,
    Height=height_92,
    HorizontalAlignment=Slider(0, range=0..100))
adjustpos_90 = AdjustElementPositioning(
    ElementsToAdjust=label_25,
    Margin="287,-45,0,5",
    AbsolutePositioning=False,
    Width=width_100,
    Height=height_94,
    HorizontalAlignment=Slider(0, range=0..100))
adjustelem_23 = AdjustElementAppearance(ElementsToAdjust=label_25, Background="255,255,255")
image_5 = CreateImage(ImageSource=panel_16, ImageWidth=width_102, ImageHeight=height_96)
adjustpos_91 = AdjustElementPositioning(
    ElementsToAdjust=image_5,
    Margin="240,-90,0,10",
    AbsolutePositioning=False,
    Width=width_101,
    Height=height_95,
    HorizontalAlignment=Slider(0, range=0..100))
separatorheight_11 = Slider(4, range=0..10)
strength_5 = Slider(4, range=0..9)
colour_17 = ColourPicker(PickedColour=RGB(230, 230, 230))
rounds = Slider(4, range=0..9)
width_103 = Slider(210, range=0..1000)
height_97 = Slider(30, range=0..1000)
width_104 = Slider(305, range=0..400)
height_98 = Slider(30, range=0..30)
width_105 = Slider(210, range=0..1000)
height_99 = Slider(30, range=0..1000)
width_106 = Slider(305, range=0..400)
height_100 = Slider(30, range=0..30)
titlesize_8 = Slider(18, range=0..30)
separator_11 = CreateSeparator(Thickness=0.5, Horizontal=True, Color=colour_17, Height=separatorheight_11)
colour_18 = ColourPicker(PickedColour=RGB(51, 121, 200))
button_34 = CreateButton(ButtonName="Select the end-effector", ButtonStyle=0)
slider_12 = CreateSlider(Slider=strength_5, ShowBounds=False, ShowTicks=False, ShowTooltip=False, ShowValLabel=True, showLabel=True)
slider_13 = CreateSlider(Slider=rounds, ShowBounds=False, ShowTicks=False, ShowTooltip=False, ShowValLabel=True, showLabel=True)
button_35 = CreateButton(ButtonName="Select the region and axis", ButtonStyle=0)
width_107 = Slider(566, range=0..1000)
height_101 = Slider(38, range=0..1000)
adjustpos_92 = AdjustElementPositioning(
    ElementsToAdjust=slider_12,
    Margin="5,20,0,10",
    AbsolutePositioning=False,
    Width=width_104,
    Height=height_98,
    HorizontalAlignment=Slider(0, range=0..100))
adjustpos_93 = AdjustElementPositioning(
    ElementsToAdjust=button_34,
    Margin="10,5,0,10",
    AbsolutePositioning=False,
    Width=width_103,
    Height=height_97,
    HorizontalAlignment=Slider(0, range=0..100))
adjustpos_94 = AdjustElementPositioning(
    ElementsToAdjust=slider_13,
    Margin="5,10,0,5",
    AbsolutePositioning=False,
    Width=width_106,
    Height=height_100,
    HorizontalAlignment=Slider(0, range=0..100))
adjustpos_95 = AdjustElementPositioning(
    ElementsToAdjust=button_35,
    Margin="10,0,0,10",
    AbsolutePositioning=False,
    Width=width_105,
    Height=height_99,
    HorizontalAlignment=Slider(0, range=0..100))
colour_19 = ColourPicker(PickedColour=RGB(230, 230, 230))
separatorheight_12 = Slider(10, range=0..10)
width_108 = Slider(400, range=0..1000)
label_26 = CreateLabel(LabelText="Kinetic Unit for Continuous Rotation", LabelSize=12, Justification=0)
adjustelem_24 = AdjustElementAppearance(ElementsToAdjust=label_26, Foreground=colour_18, FontSize=titlesize_8)
adjustpos_96 = AdjustElementPositioning(
    ElementsToAdjust=label_26,
    Margin="0,5,0,10",
    AbsolutePositioning=False,
    Width=width_107,
    Height=height_101,
    HorizontalAlignment=Slider(0, range=0..100))
true_button_7 = CreateTrueOnlyButton(ButtonName="Preview", ButtonStyle=0)
width_109 = Slider(80, range=0..1000)
height_102 = Slider(30, range=0..1000)
width_110 = Slider(450, range=0..1000)
height_103 = Slider(35, range=0..1000)
checkbox_7 = CreateCheckbox(Label="Add a lock", StartingValue=False)
width_111 = Slider(80, range=0..1000)
height_104 = Slider(30, range=0..1000)
button_36 = CreateButton(ButtonName="Finish", ButtonStyle=0)
separator_12 = CreateSeparator(Thickness=0.5, Horizontal=True, Color=colour_19, Width=width_108, Height=separatorheight_12)
merge_7 = Merge(
    Data1=separator_11,
    Data2=label_26,
    Data3=button_35,
    Data4=button_34,
    Data5=image_5,
    Data7=slider_12,
    Data8=label_24,
    Data9=slider_13,
    Data10=label_25,
    Data11=separator_12,
    Data12=checkbox_7,
    Data13=true_button_7,
    Data14=button_36)
adjustpos_97 = AdjustElementPositioning(
    ElementsToAdjust=true_button_7,
    Margin="150,-45,0,10",
    AbsolutePositioning=False,
    Width=width_109,
    Height=height_102,
    HorizontalAlignment=Slider(0, range=0..100))
stack_7 = CreateStack(UIElements=merge_7, Horizontal=Toggle(False))
adjustpos_98 = AdjustElementPositioning(
    ElementsToAdjust=button_36,
    Margin="240,-45,0,10",
    AbsolutePositioning=False,
    Width=width_111,
    Height=height_104,
    HorizontalAlignment=Slider(0, range=0..100))
adjustpos_99 = AdjustElementPositioning(ElementsToAdjust=checkbox_7, Margin="15,15,0,10", AbsolutePositioning=False, Width=width_110, Height=height_103)
hideshow_7 = HideShowElement(ElementToHideShow=stack_7, Show=motionselection.ConRotPanel, Collapse=Toggle(True), Disable=Toggle(False))

# ---- group: Default Control Panel
width_112 = Slider(860, range=0..1000)
height_105 = Slider(35, range=0..1000)
colour_20 = ColourPicker(PickedColour=RGB(200, 200, 200))
label_27 = CreateLabel(LabelText="Please select a target motion...", LabelSize=12, Justification=0)
adjustpos_100 = AdjustElementPositioning(
    ElementsToAdjust=label_27,
    Margin="75,100,0,10",
    AbsolutePositioning=False,
    Width=width_112,
    Height=height_105,
    HorizontalAlignment=Slider(0, range=0..100))
stack_8 = CreateStack(UIElements=label_27, Horizontal=Toggle(False))
adjustelem_25 = AdjustElementAppearance(ElementsToAdjust=label_27, Foreground=colour_20)
hideshow_8 = HideShowElement(ElementToHideShow=stack_8, Show=motionselection.DefaultPanel, Collapse=Toggle(True), Disable=Toggle(False))

# ----
translationaxislistener = ValueListener(Elements=button_10, SomeProperty=True)  # -> Values, Indices
setregionvaluelistener = ValueListener(Elements=button_9, SomeProperty=True)  # -> Values, Indices
setendeffectorvaluelistener = ValueListener(Elements=button_8, SomeProperty=True)  # -> Values, Indices
addlocklistener = ValueListener(Elements=checkbox_2, SomeProperty=True)  # -> Values, Indices
strengthlistener = ValueListener(Elements=slider_4, SomeProperty=True)  # -> Values, Indices
lockvaluelistener = ValueListener(Elements=checkbox, SomeProperty=True)  # -> Values, Indices
displacementvaluelistener = ValueListener(Elements=slider_3, SomeProperty=True)  # -> Values, Indices
previewvaluelistener = ValueListener(Elements=true_button, SomeProperty=True)  # -> Values, Indices
bakelistener = ValueListener(Elements=button_11, SomeProperty=True)  # -> Values, Indices
bakelistener_2 = ValueListener(Elements=button_15, SomeProperty=True)  # -> Values, Indices
regionselectionlistener = ValueListener(Elements=button_14, SomeProperty=True)  # -> Values, Indices
addlocklistener_2 = ValueListener(Elements=checkbox_5, SomeProperty=True)  # -> Values, Indices
endeffectorselectionlistener = ValueListener(Elements=button_25, SomeProperty=True)  # -> Values, Indices
speedlistener = ValueListener(Elements=slider_10, SomeProperty=True)  # -> Values, Indices
previewlistener = ValueListener(Elements=true_button_5, SomeProperty=True)  # -> Values, Indices
strengthlistener_2 = ValueListener(Elements=slider_9, SomeProperty=True)  # -> Values, Indices
bakelistener_3 = ValueListener(Elements=button_27, SomeProperty=True)  # -> Values, Indices
speedlistener_2 = ValueListener(Elements=slider_13, SomeProperty=True)  # -> Values, Indices
regionselectionlistener_2 = ValueListener(Elements=button_35, SomeProperty=True)  # -> Values, Indices
endeffectorselectionlistener_2 = ValueListener(Elements=button_34, SomeProperty=True)  # -> Values, Indices
strengthlistener_3 = ValueListener(Elements=slider_12, SomeProperty=True)  # -> Values, Indices
addlocklistener_3 = ValueListener(Elements=checkbox_7, SomeProperty=True)  # -> Values, Indices
previewlistener_2 = ValueListener(Elements=true_button_7, SomeProperty=True)  # -> Values, Indices
bakelistener_4 = ValueListener(Elements=button_36, SomeProperty=True)  # -> Values, Indices
energyvaluelistener = ValueListener(Elements=slider_2, SomeProperty=True)  # -> Values, Indices
previewlistener_3 = ValueListener(Elements=true_button_6, SomeProperty=True)  # -> Values, Indices
regionselectionlistener_3 = ValueListener(Elements=button_26, SomeProperty=True)  # -> Values, Indices
endeffectorselectionlistener_3 = ValueListener(Elements=button_13, SomeProperty=True)  # -> Values, Indices
anglelistener = ValueListener(Elements=textbox, SomeProperty=True)  # -> Values, Indices
speedlistener_3 = ValueListener(Elements=slider, SomeProperty=True)  # -> Values, Indices
addlocklistener_4 = ValueListener(Elements=checkbox_6, SomeProperty=True)  # -> Values, Indices
stepanglelistener = ValueListener(Elements=textbox_2, SomeProperty=True)  # -> Values, Indices
distancelistener = ValueListener(Elements=pulldown, SomeProperty=True)  # -> Values, Indices
regionselectionlistener_4 = ValueListener(Elements=button_30, SomeProperty=True)  # -> Values, Indices
endeffectorselectionlistener_4 = ValueListener(Elements=button_29, SomeProperty=True)  # -> Values, Indices
previewlistener_4 = ValueListener(Elements=true_button_2, SomeProperty=True)  # -> Values, Indices
strengthlistener_4 = ValueListener(Elements=slider_11, SomeProperty=True)  # -> Values, Indices
amplitudelistener = ValueListener(Elements=pulldown_2, SomeProperty=True)  # -> Values, Indices
itmoudle = InstantTranslationModule(
    RegionSelection=setregionvaluelistener.Values,
    AxisSelection=translationaxislistener.Values,
    EndeffectorSetting=setendeffectorvaluelistener.Values,
    AddLock=lockvaluelistener.Values,
    Preview=previewvaluelistener.Values,
    CompressionDisplacement=displacementvaluelistener.Values,
    Energy=energyvaluelistener.Values,
    ComponentsBake=bakelistener.Values)  # -> KineticUnit, Models, PreviewLauncher
strengthlistener_5 = ValueListener(Elements=slider_7, SomeProperty=True)  # -> Values, Indices
speedlistener_4 = ValueListener(Elements=slider_8, SomeProperty=True)  # -> Values, Indices
endeffectorselectionlistener_5 = ValueListener(Elements=button_21, SomeProperty=True)  # -> Values, Indices
addlocklistener_5 = ValueListener(Elements=checkbox_4, SomeProperty=True)  # -> Values, Indices
regionselectionlistener_5 = ValueListener(Elements=button_22, SomeProperty=True)  # -> Values, Indices
previewlistener_5 = ValueListener(Elements=true_button_4, SomeProperty=True)  # -> Values, Indices
bakelistener_5 = ValueListener(Elements=button_23, SomeProperty=True)  # -> Values, Indices
bakelistener_6 = ValueListener(Elements=button_32, SomeProperty=True)  # -> Values, Indices
addlocklistener_6 = ValueListener(Elements=checkbox_3, SomeProperty=True)  # -> Values, Indices
endeffectorselectionlistener_6 = ValueListener(Elements=button_17, SomeProperty=True)  # -> Values, Indices
speedlistener_5 = ValueListener(Elements=slider_6, SomeProperty=True)  # -> Values, Indices
previewlistener_6 = ValueListener(Elements=true_button_3, SomeProperty=True)  # -> Values, Indices
regionselectionlistener_6 = ValueListener(Elements=button_18, SomeProperty=True)  # -> Values, Indices
strengthlistener_6 = ValueListener(Elements=slider_5, SomeProperty=True)  # -> Values, Indices
amplitudelistener_2 = ValueListener(Elements=pulldown_3, SomeProperty=True)  # -> Values, Indices
ctmodule = ContinuousTranslationModule(
    RegionSelection=regionselectionlistener_3.Values,
    EndeffectorSetting=endeffectorselectionlistener.Values,
    AddLock=addlocklistener_2.Values,
    Preview=previewlistener.Values,
    Energy=strengthlistener_2.Values,
    Speed=speedlistener.Values,
    Distance=distancelistener.Values,
    ComponentsBake=bakelistener_3.Values)  # -> KineticUnit, Models, PreviewLauncher

# ---- group: Simulation for Instant Translation
height_106 = Slider(500, range=0..900)
width_113 = Slider(400, range=0..1440)
sph = Sphere(Base=PlaneXY(0, 0, 0), Radius=1)
button_37 = CreateButton(ButtonName="Load motion", ButtonStyle=0)
button_38 = CreateButton(ButtonName="Release", ButtonStyle=0)
_3dview = Create3DView(MeshToDisplay=sph, MeshColors=RGB(255, 0, 0), ViewWidth=width_113, ViewHeight=height_106)
merge_8 = Merge(Data1=button_37, Data2=button_38)
stack_9 = CreateStack(UIElements=merge_8, Horizontal=True)
rgb = ColourRGB(Alpha=255, Red="255", Green=0, Blue=0)
values_8 = ValueListener(Elements=button_38, SomeProperty=True)  # -> Values, Indices
values_9 = ValueListener(Elements=button_37, SomeProperty=True)  # -> Values, Indices
merge_9 = Merge(Data1=_3dview, Data2=stack_9)
height_107 = Slider(700, range=0..900)
width_114 = Slider(310, range=0..1440)
kms = KinergyMotionSimulatorForHumanUI(
    _3DView=_3dview,
    KineticUnitToSimulate=ctmodule.KineticUnit,
    MeshColors=rgb,
    Start=ctmodule.PreviewLauncher,
    Load=values_9.Values,
    Release=values_8.Values)
launchwin = LaunchWindow(
    Show=ctmodule.PreviewLauncher,
    Name="Kinergy Preview Window",
    Width=width_114,
    Height=height_107,
    ChildStatus=0,
    EnableHorizScroll=False)
addelems = AddElements(Window=launchwin, Elements=flatten(merge_9), DoVLChecking=True)  # -> AddedElements, ElementNames

# ----
irmoudle = InstantRotationModule(
    RegionSelection=regionselectionlistener.Values,
    EndeffectorSetting=endeffectorselectionlistener_3.Values,
    AddLock=addlocklistener.Values,
    Preview=previewlistener_4.Values,
    Energy=strengthlistener.Values,
    MaxAngle=anglelistener.Values,
    ComponentsBake=bakelistener_2.Values)  # -> KineticUnit, Models, PreviewLauncher

# ---- group: Simulation for Instant Translation
height_108 = Slider(500, range=0..900)
width_115 = Slider(400, range=0..1440)
sph_2 = Sphere(Base=PlaneXY(0, 0, 0), Radius=1)
button_39 = CreateButton(ButtonName="Load motion", ButtonStyle=0)
button_40 = CreateButton(ButtonName="Release", ButtonStyle=0)
_3dview_2 = Create3DView(MeshToDisplay=sph_2, MeshColors=RGB(255, 0, 0), ViewWidth=width_115, ViewHeight=height_108)
merge_10 = Merge(Data1=button_39, Data2=button_40)
stack_10 = CreateStack(UIElements=merge_10, Horizontal=True)
rgb_2 = ColourRGB(Alpha=255, Red="255", Green=0, Blue=0)
values_10 = ValueListener(Elements=button_40, SomeProperty=True)  # -> Values, Indices
values_11 = ValueListener(Elements=button_39, SomeProperty=True)  # -> Values, Indices
merge_11 = Merge(Data1=_3dview_2, Data2=stack_10)
height_109 = Slider(700, range=0..900)
width_116 = Slider(310, range=0..1440)
kms_2 = KinergyMotionSimulatorForHumanUI(
    _3DView=_3dview_2,
    KineticUnitToSimulate=irmoudle.KineticUnit,
    MeshColors=rgb_2,
    Start=irmoudle.PreviewLauncher,
    Load=values_11.Values,
    Release=values_10.Values)
launchwin_2 = LaunchWindow(
    Show=irmoudle.PreviewLauncher,
    Name="Kinergy Preview Window",
    Width=width_116,
    Height=height_109,
    ChildStatus=0,
    EnableHorizScroll=False)
addelems_2 = AddElements(Window=launchwin_2, Elements=flatten(merge_11), DoVLChecking=True)  # -> AddedElements, ElementNames

# ----
crmodule = ContinuousRotationModule(
    RegionSelection=regionselectionlistener_2.Values,
    EndeffectorSetting=endeffectorselectionlistener_2.Values,
    AddLock=addlocklistener_3.Values,
    Preview=previewlistener_2.Values,
    Energy=strengthlistener_3.Values,
    Speed=speedlistener_2.Values,
    ComponentsBake=bakelistener_4.Values)  # -> KineticUnit, Models, PreviewLauncher

# ---- group: Simulation for Instant Translation
height_110 = Slider(500, range=0..900)
width_117 = Slider(400, range=0..1440)
sph_3 = Sphere(Base=PlaneXY(0, 0, 0), Radius=1)
button_41 = CreateButton(ButtonName="Load motion", ButtonStyle=0)
button_42 = CreateButton(ButtonName="Release", ButtonStyle=0)
_3dview_3 = Create3DView(MeshToDisplay=sph_3, MeshColors=RGB(255, 0, 0), ViewWidth=width_117, ViewHeight=height_110)
merge_12 = Merge(Data1=button_41, Data2=button_42)
stack_11 = CreateStack(UIElements=merge_12, Horizontal=True)
rgb_3 = ColourRGB(Alpha=255, Red="255", Green=0, Blue=0)
values_12 = ValueListener(Elements=button_42, SomeProperty=True)  # -> Values, Indices
values_13 = ValueListener(Elements=button_41, SomeProperty=True)  # -> Values, Indices
merge_13 = Merge(Data1=_3dview_3, Data2=stack_11)
width_118 = Slider(500, range=0..1440)
height_111 = Slider(700, range=0..900)
kms_3 = KinergyMotionSimulatorForHumanUI(
    _3DView=_3dview_3,
    KineticUnitToSimulate=crmodule.KineticUnit,
    MeshColors=rgb_3,
    Start=crmodule.PreviewLauncher,
    Load=values_13.Values,
    Release=values_12.Values)
launchwin_3 = LaunchWindow(
    Show=crmodule.PreviewLauncher,
    Name="Kinergy Preview Window",
    Width=width_118,
    Height=height_111,
    ChildStatus=0,
    EnableHorizScroll=False)
addelems_3 = AddElements(Window=launchwin_3, Elements=flatten(merge_13), DoVLChecking=True)  # -> AddedElements, ElementNames

# ----
patternlistener = ValueListener(Elements=pulldown_4, SomeProperty=True)  # -> Values, Indices
bakelistener_7 = ValueListener(Elements=button_19, SomeProperty=True)  # -> Values, Indices
irmodule = IntermittentRotationModule(
    RegionSelection=regionselectionlistener_4.Values,
    EndeffectorSetting=endeffectorselectionlistener_4.Values,
    AddLock=addlocklistener_4.Values,
    Preview=previewlistener_3.Values,
    Energy=strengthlistener_4.Values,
    StepAngle=stepanglelistener.Values,
    Speed=speedlistener_3.Values,
    ComponentsBake=bakelistener_6.Values)  # -> KineticUnit, Models, PreviewLauncher

# ---- group: Simulation for Instant Translation
height_112 = Slider(500, range=0..900)
width_119 = Slider(400, range=0..1440)
sph_4 = Sphere(Base=PlaneXY(0, 0, 0), Radius=1)
button_43 = CreateButton(ButtonName="Load motion", ButtonStyle=0)
button_44 = CreateButton(ButtonName="Release", ButtonStyle=0)
_3dview_4 = Create3DView(MeshToDisplay=sph_4, MeshColors=RGB(255, 0, 0), ViewWidth=width_119, ViewHeight=height_112)
merge_14 = Merge(Data1=button_43, Data2=button_44)
stack_12 = CreateStack(UIElements=merge_14, Horizontal=True)
rgb_4 = ColourRGB(Alpha=255, Red="255", Green=0, Blue=0)
values_14 = ValueListener(Elements=button_44, SomeProperty=True)  # -> Values, Indices
values_15 = ValueListener(Elements=button_43, SomeProperty=True)  # -> Values, Indices
merge_15 = Merge(Data1=_3dview_4, Data2=stack_12)
width_120 = Slider(310, range=0..1440)
height_113 = Slider(700, range=0..900)
kms_4 = KinergyMotionSimulatorForHumanUI(
    _3DView=_3dview_4,
    KineticUnitToSimulate=irmodule.KineticUnit,
    MeshColors=rgb_4,
    Start=irmodule.PreviewLauncher,
    Load=values_15.Values,
    Release=values_14.Values)
launchwin_4 = LaunchWindow(
    Show=irmodule.PreviewLauncher,
    Name="Kinergy Preview Window",
    Width=width_120,
    Height=height_113,
    ChildStatus=0,
    EnableHorizScroll=False)
addelems_4 = AddElements(Window=launchwin_4, Elements=flatten(merge_15), DoVLChecking=True)  # -> AddedElements, ElementNames

height_114 = Slider(600, range=0..900)
width_121 = Slider(800, range=0..1440)
sph_5 = Sphere(Base=PlaneXY(0, 0, 0), Radius=1)
button_45 = CreateButton(ButtonName="Load the motion and lock", ButtonStyle=0)
button_46 = CreateButton(ButtonName="Release the lock", ButtonStyle=0)
_3dview_5 = Create3DView(MeshToDisplay=sph_5, MeshColors=RGB(255, 0, 0), ViewWidth=width_121, ViewHeight=height_114)
merge_16 = Merge(Data1=button_45, Data2=button_46)
rgb_5 = ColourRGB(Alpha=255, Red="255", Green="140", Blue="8")
stack_13 = CreateStack(UIElements=merge_16, Horizontal=True)
values_16 = ValueListener(Elements=button_46, SomeProperty=True)  # -> Values, Indices
merge_17 = Merge(Data1=_3dview_5, Data2=stack_13)
values_17 = ValueListener(Elements=button_45, SomeProperty=True)  # -> Values, Indices
width_122 = Slider(810, range=0..1440)
height_115 = Slider(690, range=0..900)
kms_5 = KinergyMotionSimulatorForHumanUI(
    _3DView=_3dview_5,
    KineticUnitToSimulate=itmoudle.KineticUnit,
    MeshColors=rgb_5,
    Start=itmoudle.PreviewLauncher,
    Load=values_17.Values,
    Release=values_16.Values)
launchwin_5 = LaunchWindow(
    Show=itmoudle.PreviewLauncher,
    Name="Instant Translation Motion Preview ",
    Width=width_122,
    Height=height_115,
    ChildStatus=0,
    EnableHorizScroll=False)
addelems_5 = AddElements(Window=launchwin_5, Elements=flatten(merge_17), DoVLChecking=True)  # -> AddedElements, ElementNames

# ----
iomodule = IntermittentOscillation(
    RegionSelection=regionselectionlistener_6.Values,
    EndeffectorSetting=endeffectorselectionlistener_6.Values,
    AddLock=addlocklistener_6.Values,
    Preview=previewlistener_6.Values,
    Energy=strengthlistener_6.Values,
    Amplitude=amplitudelistener_2.Values,
    Speed=speedlistener_5.Values,
    ComponentsBake=bakelistener_7.Values)  # -> KineticUnit, Models, PreviewLauncher

# ---- group: Simulation for Instant Translation
height_116 = Slider(500, range=0..900)
width_123 = Slider(400, range=0..1440)
sph_6 = Sphere(Base=PlaneXY(0, 0, 0), Radius=1)
button_47 = CreateButton(ButtonName="Load motion", ButtonStyle=0)
button_48 = CreateButton(ButtonName="Release", ButtonStyle=0)
_3dview_6 = Create3DView(MeshToDisplay=sph_6, MeshColors=RGB(255, 0, 0), ViewWidth=width_123, ViewHeight=height_116)
merge_18 = Merge(Data1=button_47, Data2=button_48)
stack_14 = CreateStack(UIElements=merge_18, Horizontal=True)
rgb_6 = ColourRGB(Alpha=255, Red="255", Green=0, Blue=0)
values_18 = ValueListener(Elements=button_48, SomeProperty=True)  # -> Values, Indices
values_19 = ValueListener(Elements=button_47, SomeProperty=True)  # -> Values, Indices
merge_19 = Merge(Data1=_3dview_6, Data2=stack_14)
width_124 = Slider(310, range=0..1440)
height_117 = Slider(700, range=0..900)
kms_6 = KinergyMotionSimulatorForHumanUI(
    _3DView=_3dview_6,
    KineticUnitToSimulate=iomodule.KineticUnit,
    MeshColors=rgb_6,
    Start=iomodule.PreviewLauncher,
    Load=values_19.Values,
    Release=values_18.Values)
launchwin_6 = LaunchWindow(
    Show=iomodule.PreviewLauncher,
    Name="Kinergy Preview Window",
    Width=width_124,
    Height=height_117,
    ChildStatus=0,
    EnableHorizScroll=False)
addelems_6 = AddElements(Window=launchwin_6, Elements=flatten(merge_19), DoVLChecking=True)  # -> AddedElements, ElementNames

# ----
rmodule = ReciprocationModule(
    RegionSelection=regionselectionlistener_5.Values,
    EndeffectorSetting=endeffectorselectionlistener_5.Values,
    AddLock=addlocklistener_5.Values,
    Preview=previewlistener_5.Values,
    Energy=strengthlistener_5.Values,
    Amplitude=amplitudelistener.Values,
    Speed=speedlistener_4.Values,
    Pattern=patternlistener.Values,
    ComponentsBake=bakelistener_5.Values)  # -> KineticUnit, Models, PreviewLauncher

# ---- group: Simulation for Instant Translation
height_118 = Slider(500, range=0..900)
width_125 = Slider(400, range=0..1440)
sph_7 = Sphere(Base=PlaneXY(0, 0, 0), Radius=1)
button_49 = CreateButton(ButtonName="Load motion", ButtonStyle=0)
button_50 = CreateButton(ButtonName="Release", ButtonStyle=0)
_3dview_7 = Create3DView(MeshToDisplay=sph_7, MeshColors=RGB(255, 0, 0), ViewWidth=width_125, ViewHeight=height_118)
merge_20 = Merge(Data1=button_49, Data2=button_50)
stack_15 = CreateStack(UIElements=merge_20, Horizontal=True)
rgb_7 = ColourRGB(Alpha=255, Red="255", Green=0, Blue=0)
values_20 = ValueListener(Elements=button_50, SomeProperty=True)  # -> Values, Indices
values_21 = ValueListener(Elements=button_49, SomeProperty=True)  # -> Values, Indices
merge_21 = Merge(Data1=_3dview_7, Data2=stack_15)
height_119 = Slider(700, range=0..900)
width_126 = Slider(310, range=0..1440)
kms_7 = KinergyMotionSimulatorForHumanUI(
    _3DView=_3dview_7,
    KineticUnitToSimulate=rmodule.KineticUnit,
    MeshColors=rgb_7,
    Start=rmodule.PreviewLauncher,
    Load=values_21.Values,
    Release=values_20.Values)
launchwin_7 = LaunchWindow(
    Show=rmodule.PreviewLauncher,
    Name="Kinergy Preview Window",
    Width=width_126,
    Height=height_119,
    ChildStatus=0,
    EnableHorizScroll=False)
addelems_7 = AddElements(Window=launchwin_7, Elements=flatten(merge_21), DoVLChecking=True)  # -> AddedElements, ElementNames

# ---- group: MAIN WINDOW
merge_22 = Merge(
    Data1=label_3,
    Data2=label_2,
    Data3=button_3,
    Data4=button_5,
    Data5=button_7,
    Data6=label,
    Data7=button,
    Data8=button_2,
    Data9=button_4,
    Data10=button_6,
    Data11=stack_8,
    Data12=stack,
    Data13=stack_2,
    Data14=stack_5,
    Data15=stack_7,
    Data16=stack_4,
    Data17=stack_3,
    Data18=stack_6)
launchwin_8 = LaunchWindow(
    Show=Toggle(True),
    Name="Kinergy Design Tool",
    Width=Slider(345, range=0..1000),
    Height=Slider(700, range=0..1000),
    ChildStatus=0,
    EnableHorizScroll=False)
addelems_8 = AddElements(Window=launchwin_8, Elements=flatten(merge_22), DoVLChecking=True)  # -> AddedElements, ElementNames

# ----
childwin = MakeChildWindow(ParentWindow=launchwin_8, ChildWindow=launchwin_3)
childwin_2 = MakeChildWindow(ParentWindow=launchwin_8, ChildWindow=launchwin_4)
childwin_3 = MakeChildWindow(ParentWindow=launchwin_8, ChildWindow=launchwin_6)
childwin_4 = MakeChildWindow(ParentWindow=launchwin_8, ChildWindow=launchwin)
childwin_5 = MakeChildWindow(ParentWindow=launchwin_8, ChildWindow=launchwin_2)
childwin_6 = MakeChildWindow(ParentWindow=launchwin_8, ChildWindow=launchwin_7)
childwin_7 = MakeChildWindow(ParentWindow=launchwin_8, ChildWindow=launchwin_5)
